# Grasshopper definition housing.gh (Grasshopper 1.0.7)

height = Slider(25, range=20..50)
length = Slider(55.2, range=25..75)
width = Slider(60, range=25..75)

division = Division(A=height, B=2)
division_2 = Division(A=length, B=2)
division_3 = Division(A=width, B=2)
main_radius = Slider(5, range=0..10)
construct_point = ConstructPoint(XCoordinate=expr("-x", division_2), YCoordinate=expr("-x", division_3), ZCoordinate=expr("-x", division))
xy_plane = XYPlane(Origin=Point(0, 0, 0))
construct_point_2 = ConstructPoint(XCoordinate=division_2, YCoordinate=division_3, ZCoordinate=division)
box_2pt = Box2Pt(PointA=construct_point_2, PointB=construct_point, Plane=xy_plane)
deconstruct_brep = DeconstructBrep(Brep=box_2pt)  # -> Faces, Edges, Vertices
point_on_curve = PointOnCurve(deconstruct_brep.Edges, parameter=0.5)
member_index = MemberIndex(Set=point_on_curve, Member=point_on_curve)  # -> Index, Count
point_list = PointList(Points=point_on_curve, Size=Slider(2.5, range=0..10))
value_list = ValueList({"Fillet": 0, "Chamfer": 1, "Blend": 2}, selected="Fillet")
flatten_tree = FlattenTree(Tree=member_index.Index, Path="{0}")
fillet_edge = FilletEdge(Shape=box_2pt, Blend=value_list, Metric=0, Edges=flatten_tree, Radii=main_radius)

gap = Slider(0.1, range=0..1)
xy_plane_2 = XYPlane(Origin=Point(0, 0, 0))
division_4 = Division(A=gap, B=2)
plane_offset = PlaneOffset(BasePlane=xy_plane_2, Offset=expr("-x", division))
plane_offset_2 = PlaneOffset(BasePlane=xy_plane_2, Offset=division_4)
plane_offset_3 = PlaneOffset(BasePlane=xy_plane_2, Offset=expr("-x", division_4))
plane_offset_4 = PlaneOffset(BasePlane=xy_plane_2, Offset=division)
rectangle_2pt = Rectangle2Pt(Plane=plane_offset_2, PointA=construct_point_2, PointB=construct_point, Radius=0)  # -> Rectangle, Length
rectangle_2pt_2 = Rectangle2Pt(Plane=plane_offset_3, PointA=construct_point_2, PointB=construct_point, Radius=0)  # -> Rectangle, Length
rectangle_2pt_3 = Rectangle2Pt(Plane=plane_offset_4, PointA=construct_point_2, PointB=construct_point, Radius=0)  # -> Rectangle, Length
rectangle_2pt_4 = Rectangle2Pt(Plane=plane_offset, PointA=construct_point_2, PointB=construct_point, Radius=0)  # -> Rectangle, Length
loft = Loft(
    Curves=[rectangle_2pt_3.Rectangle, rectangle_2pt_2.Rectangle],
    Options={Adjust=False, Closed=False, LoftEnds=0, LoftSimp=0, LoftType=0, Rebuild=10, Refit=0.01})
loft_2 = Loft(
    Curves=[rectangle_2pt.Rectangle, rectangle_2pt_4.Rectangle],
    Options={Adjust=False, Closed=False, LoftEnds=0, LoftSimp=0, LoftType=0, Rebuild=10, Refit=0.01})
cap_holes = CapHoles(Brep=loft)
cap_holes_2 = CapHoles(Brep=loft_2)
solid_difference = SolidDifference(BrepsA=fillet_edge, BrepsB=cap_holes)
solid_difference_2 = SolidDifference(BrepsA=fillet_edge, BrepsB=cap_holes_2)

wall_thickness = Slider(1.5, range=1..3)
deconstruct_brep_2 = DeconstructBrep(Brep=fillet_edge)  # -> Faces, Edges, Vertices
flatten_tree_2 = FlattenTree(Tree=deconstruct_brep_2.Faces, Path="{0}")
offset = Offset(Surface=flatten_tree_2, Distance=expr("-x", wall_thickness), Retrim=True)
brep_join = BrepJoin(Breps=offset)  # -> Breps, Closed

division_5 = Division(A=Slider(5, range=0..10), B=2)
vector_xyz = VectorXYZ(XComponent=expr("-x", division_5), YComponent=expr("-x", division_5), ZComponent=0)  # -> Vector, Length
vector_xyz_2 = VectorXYZ(XComponent=division_5, YComponent=division_5, ZComponent=0)  # -> Vector, Length
xy_plane_3 = XYPlane(Origin=Point(0, 0, 0))
plane_offset_5 = PlaneOffset(BasePlane=xy_plane_3, Offset=expr("-x", division))

# ---- group: Raspberry Pi
construct_point_3 = ConstructPoint(XCoordinate=Slider(-0.5, range=-5..5), YCoordinate=Slider(0, range=-5..5), ZCoordinate=Slider(-3.5, range=-10..0))
xy_plane_4 = XYPlane(Origin=Point(0, 0, 0))
yz_plane = YZPlane(Origin=Point(0, 0, 0))
xz_plane = XZPlane(Origin=Point(0, 0, 0))
plane_origin = PlaneOrigin(Base=xz_plane, Origin=construct_point_3)
plane_origin_2 = PlaneOrigin(Base=yz_plane, Origin=construct_point_3)
plane_origin_3 = PlaneOrigin(Base=xy_plane_4, Origin=construct_point_3)
number_slider = Slider(1, range=0..1)
division_6 = Division(A=Slider(51.2, range=0..100), B=2)
division_7 = Division(A=Slider(21, range=0..100), B=2)
division_8 = Division(A=number_slider, B=2)
vector_xyz_3 = VectorXYZ(XComponent=division_6, YComponent=division_7, ZComponent=division_8)  # -> Vector, Length
reverse = Reverse(Vector=vector_xyz_3.Vector)
move = Move(Geometry=construct_point_3, Motion=vector_xyz_3.Vector)  # -> Geometry, Transform
move_2 = Move(Geometry=construct_point_3, Motion=reverse)  # -> Geometry, Transform
box_2pt_2 = Box2Pt(PointA=move.Geometry, PointB=move_2.Geometry, Plane=plane_origin_3)

# ---- group: Raspberry
vector_xyz_4 = VectorXYZ(XComponent=expr("-x", Slider(2, range=0..5)), YComponent=expr("-x", Slider(3.8, range=0..5)), ZComponent=0)  # -> Vector, Length
move_3 = Move(Geometry=move.Geometry, Motion=vector_xyz_4.Vector)  # -> Geometry, Transform
mirror = Mirror(Geometry=move_3.Geometry, Plane=plane_origin)  # -> Geometry, Transform
merge = Merge(Data1=move_3.Geometry, Data2=mirror.Geometry)
mirror_2 = Mirror(Geometry=merge, Plane=plane_origin_2)  # -> Geometry, Transform
number_slider_2 = Slider(1, range=0..4)
merge_2 = Merge(Data1=mirror_2.Geometry, Data2=merge)
cylinder = Cylinder(Base=merge_2, Radius=number_slider_2, Length=expr("-x", number_slider))
cap_holes_3 = CapHoles(Brep=cylinder)

# ---- group: Raspberry Pi (continued)
solid_difference_3 = SolidDifference(BrepsA=box_2pt_2, BrepsB=cap_holes_3)

# ----
number_slider_3 = Slider(0.5, range=0..1)
addition = Addition(A=division_8, B=number_slider_3)
plane_offset_6 = PlaneOffset(BasePlane=plane_origin_3, Offset=expr("-x", addition))
rectangle_2pt_5 = Rectangle2Pt(Plane=plane_offset_6, PointA=move.Geometry, PointB=move_2.Geometry, Radius=0)  # -> Rectangle, Length
offset_2 = Offset(Curve=rectangle_2pt_5.Rectangle, Distance=number_slider_3, Plane=plane_offset_6, Corners=1)
xy_plane_5 = XYPlane(Origin=Point(0, 0, 0))
flatten_tree_3 = FlattenTree(Tree=offset_2, Path="{0}")
project = Project(Geometry=flatten_tree_3, Plane=xy_plane_5)  # -> Geometry, Transform
loft_3 = Loft(
    Curves=[project.Geometry, flatten_tree_3],
    Options={Adjust=False, Closed=False, LoftEnds=0, LoftSimp=0, LoftType=0, Rebuild=10, Refit=0.01})
cap_holes_4 = CapHoles(Brep=loft_3)

number_slider_4 = Slider(3.9, range=0..10)
subtraction = Subtraction(A=division_2, B=main_radius)
vector_xyz_5 = VectorXYZ(XComponent=expr("-x", subtraction), YComponent=Slider(2.6, range=0..10), ZComponent=expr("-x", Slider(0.4, range=0..1)))  # -> Vector, Length
vector_xyz_6 = VectorXYZ(XComponent=expr("-x", subtraction), YComponent=number_slider_4, ZComponent=expr("-x", Slider(1, range=0..1)))  # -> Vector, Length
vector_xyz_7 = VectorXYZ(XComponent=expr("-x", subtraction), YComponent=number_slider_4, ZComponent=expr("-x", Slider(3, range=0..10)))  # -> Vector, Length
move_4 = Move(Geometry=construct_point_3, Motion=vector_xyz_5.Vector)  # -> Geometry, Transform
move_5 = Move(Geometry=construct_point_3, Motion=vector_xyz_6.Vector)  # -> Geometry, Transform
move_6 = Move(Geometry=construct_point_3, Motion=vector_xyz_7.Vector)  # -> Geometry, Transform
mirror_3 = Mirror(Geometry=move_5.Geometry, Plane=plane_origin)  # -> Geometry, Transform
mirror_4 = Mirror(Geometry=move_6.Geometry, Plane=plane_origin)  # -> Geometry, Transform
mirror_5 = Mirror(Geometry=move_4.Geometry, Plane=plane_origin)  # -> Geometry, Transform
merge_3 = Merge(
    Data1=move_4.Geometry,
    Data2=move_5.Geometry,
    Data3=move_6.Geometry,
    Data4=mirror_4.Geometry,
    Data5=mirror_3.Geometry,
    Data6=mirror_5.Geometry)
shift_list = ShiftList(List=merge_3, Shift=1, Wrap=True)
line = Line(StartPoint=merge_3, EndPoint=shift_list)
divide_length = DivideLength(Curve=line, Length=Slider(0.4, range=0..1))  # -> Points, Tangents, Parameters
list_item = ListItem(List=divide_length.Points, Index=1, Wrap=False)
list_item_2 = ListItem(List=divide_length.Points, Index=-1, Wrap=True)
subtraction_2 = Subtraction(A=division_2, B=wall_thickness)
flatten_tree_4 = FlattenTree(Tree=[list_item, list_item_2], Path="{0}")
yz_plane_2 = YZPlane(Origin=Point(0, 0, 0))
addition_2 = Addition(A=division_2, B=Slider(2, range=0..10))
yz_plane_3 = YZPlane(Origin=Point(0, 0, 0))
addition_3 = Addition(A=subtraction_2, B=number_slider_3)
nurbs_curve = NurbsCurve(Vertices=flatten_tree_4, Degree=2, Periodic=True)  # -> Curve, Length, Domain
plane_offset_7 = PlaneOffset(BasePlane=yz_plane_2, Offset=expr("-x", addition_2))
plane_offset_8 = PlaneOffset(BasePlane=yz_plane_3, Offset=expr("-x", addition_3))
offset_3 = Offset(Curve=nurbs_curve.Curve, Distance=Slider(0.3, range=0..1), Plane=PlaneXY(0, 0, 0), Corners=1)
project_2 = Project(Geometry=nurbs_curve.Curve, Plane=plane_offset_7)  # -> Geometry, Transform
flatten_tree_5 = FlattenTree(Tree=offset_3, Path="{0}")
project_3 = Project(Geometry=flatten_tree_5, Plane=plane_offset_8)  # -> Geometry, Transform
loft_4 = Loft(
    Curves=[nurbs_curve.Curve, project_2.Geometry],
    Options={Adjust=False, Closed=False, LoftEnds=0, LoftSimp=0, LoftType=0, Rebuild=10, Refit=0.01})
cap_holes_5 = CapHoles(Brep=loft_4)
loft_5 = Loft(
    Curves=[project_3.Geometry, flatten_tree_5],
    Options={Adjust=False, Closed=False, LoftEnds=0, LoftSimp=0, LoftType=0, Rebuild=10, Refit=0.01})
cap_holes_6 = CapHoles(Brep=loft_5)
solid_union = SolidUnion(Breps=[cap_holes_5, cap_holes_6])

xy_plane_6 = XYPlane(Origin=Point(0, 0, 0))
plane_offset_9 = PlaneOffset(BasePlane=xy_plane_6, Offset=number_slider_3)
project_4 = Project(Geometry=move_3.Geometry, Plane=plane_offset_9)  # -> Geometry, Transform
yz_plane_4 = YZPlane(Origin=Point(0, 0, 0))
plane_offset_10 = PlaneOffset(BasePlane=yz_plane_4, Offset=division_2)
xy_plane_7 = XYPlane(Origin=Point(0, 0, 0))
project_5 = Project(Geometry=project_4.Geometry, Plane=plane_offset_10)  # -> Geometry, Transform
plane_offset_11 = PlaneOffset(BasePlane=xy_plane_7, Offset=division)
merge_4 = Merge(Data1=project_4.Geometry, Data2=project_5.Geometry)
project_6 = Project(Geometry=merge_4, Plane=plane_offset_11)  # -> Geometry, Transform
reverse_list = ReverseList(List=project_6.Geometry)
merge_5 = Merge(Data1=merge_4, Data2=reverse_list)
polyline = PolyLine(Vertices=merge_5, Closed=True)

project_7 = Project(Geometry=move_3.Geometry, Plane=plane_offset_6)  # -> Geometry, Transform
yz_plane_5 = YZPlane(Origin=Point(0, 0, 0))
plane_offset_12 = PlaneOffset(BasePlane=yz_plane_5, Offset=division_2)
xy_plane_8 = XYPlane(Origin=Point(0, 0, 0))
plane_offset_13 = PlaneOffset(BasePlane=xy_plane_8, Offset=expr("-x", division))
project_8 = Project(Geometry=project_7.Geometry, Plane=plane_offset_12)  # -> Geometry, Transform
merge_6 = Merge(Data1=project_7.Geometry, Data2=project_8.Geometry)
project_9 = Project(Geometry=merge_6, Plane=plane_offset_13)  # -> Geometry, Transform
reverse_list_2 = ReverseList(List=project_9.Geometry)
number_slider_5 = Slider(1, range=0..2)
merge_7 = Merge(Data1=merge_6, Data2=reverse_list_2)
negative = Negative(Value=number_slider_5)
polyline_2 = PolyLine(Vertices=merge_7, Closed=True)
box_rectangle = BoxRectangle(Rectangle=[polyline_2, polyline], Height=number_slider_5)
box_rectangle_2 = BoxRectangle(Rectangle=[polyline_2, polyline], Height=negative)
solid_union_2 = SolidUnion(Breps=[box_rectangle, box_rectangle_2])
mirror_6 = Mirror(Geometry=solid_union_2, Plane=plane_origin)  # -> Geometry, Transform
mirror_7 = Mirror(Geometry=[solid_union_2, mirror_6.Geometry], Plane=plane_origin_2)  # -> Geometry, Transform
solid_union_3 = SolidUnion(Breps=[mirror_7.Geometry, solid_union_2, mirror_6.Geometry])

plane_offset_14 = PlaneOffset(BasePlane=plane_origin_3, Offset=expr("-x", division_8))
number_slider_6 = Slider(2, range=0..5)
project_10 = Project(Geometry=merge_2, Plane=plane_offset_14)  # -> Geometry, Transform
division_9 = Division(A=Slider(3.2, range=0..5), B=2)
xy_plane_9 = XYPlane(Origin=Point(0, 0, 0))
circle_cnr = CircleCNR(Center=project_10.Geometry, Normal=plane_offset_14, Radius=division_9)
plane_offset_15 = PlaneOffset(BasePlane=xy_plane_9, Offset=expr("-x", division))
plane_offset_16 = PlaneOffset(BasePlane=plane_offset_14, Offset=number_slider_6)
graft_tree = GraftTree(Tree=circle_cnr, IncludeEmptyLists=True, IncludeNullItems=True)
subtraction_3 = Subtraction(A=number_slider_2, B=Slider(0.2, range=0..1))
project_11 = Project(Geometry=graft_tree, Plane=plane_offset_15)  # -> Geometry, Transform
project_12 = Project(Geometry=merge_2, Plane=plane_offset_16)  # -> Geometry, Transform
loft_6 = Loft(
    Curves=[graft_tree, project_11.Geometry],
    Options={Adjust=False, Closed=False, LoftEnds=0, LoftSimp=0, LoftType=0, Rebuild=10, Refit=0.01})
cylinder_2 = Cylinder(Base=project_12.Geometry, Radius=subtraction_3, Length=expr("-x", number_slider_6))
flatten_tree_6 = FlattenTree(Tree=loft_6, Path="{0}")
cap_holes_7 = CapHoles(Brep=cylinder_2)
cap_holes_8 = CapHoles(Brep=flatten_tree_6)
solid_union_4 = SolidUnion(Breps=[cap_holes_8, cap_holes_7])

xy_plane_10 = XYPlane(Origin=Point(0, 0, 0))
addition_4 = Addition(A=division_8, B=Slider(0.2, range=0..1))
evaluate_box = EvaluateBox(Box=cap_holes_7, UParameter=0.5, VParameter=0.5, WParameter=0.5)  # -> Plane, Point, Include
plane_offset_17 = PlaneOffset(BasePlane=plane_origin_3, Offset=addition_4)
plane_offset_18 = PlaneOffset(BasePlane=xy_plane_10, Offset=division)
project_13 = Project(Geometry=graft_tree, Plane=plane_offset_18)  # -> Geometry, Transform
project_14 = Project(Geometry=graft_tree, Plane=plane_offset_17)  # -> Geometry, Transform
scale = Scale(Geometry=cap_holes_7, Center=evaluate_box.Point, Factor=Slider(1.2, range=0..10))  # -> Geometry, Transform
loft_7 = Loft(
    Curves=[project_14.Geometry, project_13.Geometry],
    Options={Adjust=False, Closed=False, LoftEnds=0, LoftSimp=0, LoftType=0, Rebuild=10, Refit=0.01})
flatten_tree_7 = FlattenTree(Tree=loft_7, Path="{0}")
cap_holes_9 = CapHoles(Brep=flatten_tree_7)
solid_difference_4 = SolidDifference(BrepsA=cap_holes_9, BrepsB=scale.Geometry)
multiplication = Multiplication(A=division, B=2)
box_rectangle_3 = BoxRectangle(Rectangle=rectangle_2pt.Rectangle, Height=multiplication)
solid_difference_5 = SolidDifference(BrepsA=solid_difference_4, BrepsB=box_rectangle_3)

subtraction_4 = Subtraction(A=division_7, B=Slider(6.6, range=0..10))
subtraction_5 = Subtraction(A=division_6, B=Slider(11.5, range=0..100))
vector_xyz_8 = VectorXYZ(XComponent=expr("-x", subtraction_5), YComponent=subtraction_4, ZComponent=0)  # -> Vector, Length
addition_5 = Addition(A=division_8, B=Slider(3, range=0..10))
move_7 = Move(Geometry=construct_point_3, Motion=vector_xyz_8.Vector)  # -> Geometry, Transform
plane_offset_19 = PlaneOffset(BasePlane=plane_origin_3, Offset=expr("-x", addition_5))
project_15 = Project(Geometry=move_7.Geometry, Plane=plane_offset_19)  # -> Geometry, Transform
move_8 = Move(Geometry=project_15.Geometry, Motion=vector_xyz_2.Vector)  # -> Geometry, Transform
move_9 = Move(Geometry=project_15.Geometry, Motion=vector_xyz.Vector)  # -> Geometry, Transform
plane_offset_20 = PlaneOffset(BasePlane=plane_offset_19, Offset=expr("-x", Slider(0.5, range=0..1)))
rectangle_2pt_6 = Rectangle2Pt(Plane=plane_offset_20, PointA=move_8.Geometry, PointB=move_9.Geometry, Radius=Slider(1, range=0..3))  # -> Rectangle, Length
project_16 = Project(Geometry=rectangle_2pt_6.Rectangle, Plane=plane_offset_5)  # -> Geometry, Transform
loft_8 = Loft(
    Curves=[rectangle_2pt_6.Rectangle, project_16.Geometry],
    Options={Adjust=False, Closed=False, LoftEnds=0, LoftSimp=0, LoftType=0, Rebuild=10, Refit=0.01})
cap_holes_10 = CapHoles(Brep=loft_8)

project_17 = Project(Geometry=rectangle_2pt_6.Rectangle, Plane=plane_offset_19)  # -> Geometry, Transform
plane_offset_21 = PlaneOffset(BasePlane=plane_offset_19, Offset=expr("-x", Slider(2, range=0..10)))
offset_4 = Offset(Curve=project_17.Geometry, Distance=expr("-x", Slider(1.3, range=0..2)), Plane=plane_offset_5, Corners=1)
offset_5 = Offset(Curve=project_17.Geometry, Distance=expr("-x", Slider(0.8, range=0..1)), Plane=plane_offset_19, Corners=1)
flatten_tree_8 = FlattenTree(Tree=offset_4, Path="{0}")
flatten_tree_9 = FlattenTree(Tree=offset_5, Path="{0}")
project_18 = Project(Geometry=flatten_tree_8, Plane=plane_offset_5)  # -> Geometry, Transform
project_19 = Project(Geometry=flatten_tree_9, Plane=plane_offset_21)  # -> Geometry, Transform
loft_9 = Loft(
    Curves=[flatten_tree_8, project_18.Geometry],
    Options={Adjust=False, Closed=False, LoftEnds=0, LoftSimp=0, LoftType=0, Rebuild=10, Refit=0.01})
loft_10 = Loft(
    Curves=[project_19.Geometry, flatten_tree_9],
    Options={Adjust=False, Closed=False, LoftEnds=0, LoftSimp=0, LoftType=0, Rebuild=10, Refit=0.01})
cap_holes_11 = CapHoles(Brep=loft_9)
cap_holes_12 = CapHoles(Brep=loft_10)
solid_union_5 = SolidUnion(Breps=[cap_holes_12, cap_holes_11])

# ---- group: Knob
number_slider_7 = Slider(0.1, range=0..1)
division_10 = Division(A=wall_thickness, B=Slider(10, range=0..10))
offset_6 = Offset(Curve=flatten_tree_8, Distance=expr("-x", number_slider_7), Plane=plane_offset_5, Corners=1)
offset_7 = Offset(Curve=flatten_tree_9, Distance=expr("-x", number_slider_7), Plane=plane_offset_19, Corners=1)
plane_offset_22 = PlaneOffset(BasePlane=plane_offset_5, Offset=division_10)
flatten_tree_10 = FlattenTree(Tree=offset_6, Path="{0}")
flatten_tree_11 = FlattenTree(Tree=offset_7, Path="{0}")
project_20 = Project(Geometry=flatten_tree_10, Plane=plane_offset_22)  # -> Geometry, Transform
project_21 = Project(Geometry=flatten_tree_11, Plane=plane_offset_21)  # -> Geometry, Transform
loft_11 = Loft(
    Curves=[flatten_tree_10, project_20.Geometry],
    Options={Adjust=False, Closed=False, LoftEnds=0, LoftSimp=0, LoftType=0, Rebuild=10, Refit=0.01})
loft_12 = Loft(
    Curves=[project_21.Geometry, flatten_tree_11],
    Options={Adjust=False, Closed=False, LoftEnds=0, LoftSimp=0, LoftType=0, Rebuild=10, Refit=0.01})
cap_holes_13 = CapHoles(Brep=loft_11)
cap_holes_14 = CapHoles(Brep=loft_12)
solid_union_6 = SolidUnion(Breps=[cap_holes_14, cap_holes_13])

# ----
solid_difference_6 = SolidDifference(BrepsA=cap_holes_10, BrepsB=solid_union_5)

solid_union_7 = SolidUnion(Breps=[solid_union_3, solid_union_4, solid_difference_6])
solid_union_8 = SolidUnion(Breps=[cap_holes_4, brep_join.Breps, solid_union, solid_union_5])
solid_difference_7 = SolidDifference(BrepsA=solid_union_8, BrepsB=solid_union_7)
solid_difference_8 = SolidDifference(BrepsA=solid_difference_7, BrepsB=cap_holes_2)
solid_difference_9 = SolidDifference(BrepsA=solid_difference_7, BrepsB=cap_holes)
solid_difference_10 = SolidDifference(BrepsA=solid_difference_8, BrepsB=solid_difference_4)
solid_difference_11 = SolidDifference(BrepsA=solid_difference_2, BrepsB=solid_difference_10)
solid_union_9 = SolidUnion(Breps=[solid_difference_11, solid_difference_5])
solid_difference_12 = SolidDifference(BrepsA=solid_difference, BrepsB=solid_difference_9)
